vi "index.gviweb"   [LabVIEW NXG 3.1.0]
panel controls:
  "Ordem de serviço": string
  "Ferramenta": string
  "Temperature 1": f64
  "Temperature 2": f64
  "Get Ordem de serviço": bool
  "Get Ferramenta": bool
uses:
  NI::HTTP::GET.gvi
diagram:
  # Place setup code before the loop. For example, perform initial data communication and wire the results into the loop.
  # Top-Level WebVIs usually contain a While Loop that never stops so that they can continue running as long as the web page is open in the user's web browser.
  while {
    event {
      on "Get Ordem de serviço" Value changed {
        w1 = "http://10.48.0.67:8001/WebService/ServiceOrderBarcode_(Get)"
        call "GET.gvi"(url=w1) -> (body=w2)
        $"Ordem de serviço" <- w2
      }
      on "Get Ferramenta" Value changed {
        call "GET.gvi"(url="http://10.48.0.67:8001/WebService/ToolBarcode_(Get)") -> (body=w3)
        $Ferramenta <- w3
      }
    }
    Wait(time to wait=50)
    stop if FALSE
  }
